# Grasshopper definition generator.gh (Grasshopper 1.0.8)
# plug-ins: RhinoCodePluginGH

core = Python3Script(L=Slider(79, range=0..100))  # -> out, Tetra, Pts, VtxPlanes
# ---------- core: Python ----------
import Rhino.Geometry as rg
import math

# Grasshopper input:
#   L (float) edge length, default = 2
# Grasshopper output:
#   Tetra (Brep)
#   Pts (list[Point3d])
#   VtxPlanes (list[Plane])  # plane at each vertex

if L is None or L <= 0:
    L = 2.0

s = float(L)

# Base equilateral triangle on XY plane
A = rg.Point3d(0, 0, 0)
B = rg.Point3d(s, 0, 0)
C = rg.Point3d(0.5*s, 0.5*math.sqrt(3)*s, 0)

# Apex point above the centroid of base triangle
centroid_base = rg.Point3d(0.5*s, (math.sqrt(3)/6.0)*s, 0)
h = math.sqrt(2.0/3.0) * s  # tetrahedron height
D = rg.Point3d(centroid_base.X, centroid_base.Y, h)

Pts = [A, B, C, D]

# Build tetra as joined triangular Breps
faces = []
for (p, q, r) in [(A, B, C), (A, B, D), (B, C, D), (C, A, D)]:
    brep = rg.Brep.CreateFromCornerPoints(p, q, r, 1e-9)
    if brep: 
        faces.append(brep)

joined = rg.Brep.JoinBreps(faces, 1e-6)
Tetra = joined[0] if joined and len(joined) > 0 else None

# Tetra "center": use average of vertices (centroid of vertex set)
center = rg.Point3d(
    (A.X + B.X + C.X + D.X) / 4.0,
    (A.Y + B.Y + C.Y + D.Y) / 4.0,
    (A.Z + B.Z + C.Z + D.Z) / 4.0
)

def make_vertex_plane(origin, center_pt):
    # Z axis: vector from center to vertex
    z = rg.Vector3d(origin.X - center_pt.X, origin.Y - center_pt.Y, origin.Z - center_pt.Z)
    if not z.Unitize():
        # fallback (shouldn't happen)
        z = rg.Vector3d.ZAxis

    # Pick a reference vector not parallel to z, to construct X/Y
    ref = rg.Vector3d.ZAxis
    if abs(rg.Vector3d.Multiply(z, ref)) > 0.999:  # nearly parallel
        ref = rg.Vector3d.XAxis

    x = rg.Vector3d.CrossProduct(ref, z)
    if not x.Unitize():
        x = rg.Vector3d.XAxis

    y = rg.Vector3d.CrossProduct(z, x)
    if not y.Unitize():
        y = rg.Vector3d.YAxis

    return rg.Plane(origin, x, y)

VtxPlanes = [make_vertex_plane(p, center) for p in Pts]
# ---------- end core ----------
geo = Geometry([<brep referenced from the Rhino model> x2, <curve referenced from the Rhino model>, <extrusion referenced from the Rhino model>])
geo_2 = Geometry([<brep referenced from the Rhino model> x2])
circle = Circle({Plane=Plane(origin=(430.1117647, 77.22441841, 142.674658), x=(-0.9697749964, -0.2440009351, 0), y=(-0.2440009351, 0.9697749964, 0)), Radius=21.484343})
Z = UnitZ(Factor=Slider(0, range=-30..30))
geo_3 = Geometry(geo)
group = Group(Objects=geo_3)
bbox = BoundingBox(Content=group, Plane=PlaneXY(0, 0, 0))  # -> Box, Box_2
balloon_generator = Python3Script(
    C=circle,
    d=[Slider(69.83, range=0..100), Slider(37.05, range=0..100), Slider(42.99, range=0..100), Slider(67.34, range=0..100)])  # -> out, S, Center, Trimmed, CutPlane
# ---------- balloon_generator: Python ----------
import Rhino.Geometry as rg
import math

# Inputs:
# C : Circle
# d : float (distance from sphere center to circle center)

# Outputs:
# S       : Sphere
# Center  : Point3d
# Trimmed : Brep
# CutPlane: Plane

tol = 1e-6

S = None
Center = None
Trimmed = None
CutPlane = None

if C is not None:
    r = C.Radius
    plane = C.Plane
    CutPlane = plane

    # Sphere radius: R^2 = r^2 + d^2
    R = math.sqrt(r * r + d * d)

    # Sphere center: along circle plane normal
    Center = plane.Origin + plane.ZAxis * d
    S = rg.Sphere(Center, R)

    sphere_brep = S.ToBrep()

    # Make a sufficiently large cutting plane surface
    size = R * 4.0 + r * 4.0 + abs(d) * 2.0
    udom = rg.Interval(-size, size)
    vdom = rg.Interval(-size, size)
    cutter = rg.PlaneSurface(plane, udom, vdom).ToBrep()

    # Split sphere by the circle plane
    pieces = sphere_brep.Split(cutter, tol)

    if pieces and len(pieces) > 0:
        kept = None

        # Keep the piece on the same side as the sphere center
        # relative to the cutting plane
        for piece in pieces:
            amp = rg.AreaMassProperties.Compute(piece)
            if amp is None:
                continue

            c = amp.Centroid
            vec = c - plane.Origin

            # signed distance direction test
            side = rg.Vector3d.Multiply(vec, plane.ZAxis)

            # sphere center is always on the side indicated by d
            # if d >= 0, keep positive side; if d < 0, keep negative side
            if d >= 0 and side >= -tol:
                kept = piece
                break
            elif d < 0 and side <= tol:
                kept = piece
                break

        # fallback: choose the piece whose centroid is closer to the sphere center
        if kept is None:
            best_dist = None
            for piece in pieces:
                amp = rg.AreaMassProperties.Compute(piece)
                if amp is None:
                    continue
                dist = amp.Centroid.DistanceTo(Center)
                if best_dist is None or dist < best_dist:
                    best_dist = dist
                    kept = piece

        Trimmed = kept
# ---------- end balloon_generator ----------
volume = Volume(Geometry=bbox.Box)  # -> Volume, Centroid
move = Move(Geometry=balloon_generator.CutPlane, Motion=Z)  # -> Geometry, Transform
pln = Plane(volume.Centroid)
pflip = FlipPlane(Plane=move.Geometry, ReverseX=False, ReverseY=False, SwapAxes=False)
brep = Brep(balloon_generator.Trimmed)
brep_2 = Brep(core.Tetra)
orient = Orient(Geometry=graft(geo_3), Source=pflip, Target=core.VtxPlanes)  # -> Geometry, Transform
orient_2 = Orient(Geometry=brep, Source=pflip, Target=core.VtxPlanes)  # -> Geometry, Transform
